# Grasshopper definition example.gh (Grasshopper 1.0.8)
# plug-ins: K2Engineering, Human

# ---- group: GEOMETRISCHE PARAMETER
spannweite_l_m = Slider(6, range=1..10)
höhe_h_m = Slider(3, range=1..5)
panel = Panel("""GEOMETRIE
PARAMETER""")
panel_2 = Panel("""6.0
3.0""")
reset_geometrie = Button()
reset = CSharpScript(Reset=reset_geometrie, Parameters=[spannweite_l_m, höhe_h_m], Values=panel_2)  # -> out; inputs Reset: Boolean, Parameters: list, Values: list of Double
# ---------- reset: C# ----------
// Grasshopper Script Instance
#region Usings
using System;
using System.Linq;
using System.Collections;
using System.Collections.Generic;
using System.Drawing;

using Rhino;
using Rhino.Geometry;

using Grasshopper;
using Grasshopper.Kernel;
using Grasshopper.Kernel.Data;
using Grasshopper.Kernel.Types;
#endregion

public class Script_Instance : GH_ScriptInstance
{
    #region Notes
    /* 
      Members:
        RhinoDoc RhinoDocument
        GH_Document GrasshopperDocument
        IGH_Component Component
        int Iteration

      Methods (Virtual & overridable):
        Print(string text)
        Print(string format, params object[] args)
        Reflect(object obj)
        Reflect(object obj, string method_name)
    */
    #endregion

    private void RunScript(bool Reset, List<object> Parameters, List<double> Values)
    {
        Grasshopper.Kernel.Special.GH_NumberSlider slider;

        int num_sliders = Parameters.Count();
        int num_values = Values.Count();

        if (num_sliders != num_values)
            Print("Error: Parameters and Values should match in number of elements");
        else
        {    
            int i;

            if (Reset == true)
            {
                Print("Reseting to default values");

                for (i = 0; i < num_sliders ; i++)
                {
                    slider = Component.Params.Input[1].Sources[i] as Grasshopper.Kernel.Special.GH_NumberSlider; //try to cast that thing as a slider

                    if (slider != null)
                    {
                        slider.TrySetSliderValue((decimal) Values[i]);
                    }
                }
            }
        }
    }
}
# ---------- end reset ----------
panel_3 = Panel(reset)

# ----
anzahl_unterteilung_stütze_ns = Slider(3, range=1..10)
anzahl_unterteilung_stütze_ns_2 = Integer(anzahl_unterteilung_stütze_ns)

# ---- group: DARSTELLUNG DER VERFORMUNG
wireframe_verformung = BooleanToggle(True)
farbe = ColourSwatch(SwatchColor=RGB(255, 255, 255))
faktor = Slider(49, range=1..200)
werte_der_bewegungen_mm = BooleanToggle(False)
farbe_2 = ColourSwatch(SwatchColor=RGB(0, 0, 0))

# ----
nachkommastellen = Slider(0, range=0..4)

# ---- group: LOGOS ON VIEWPORT
str2img = DeserializeImageFromString(ImageString=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)
trigger = Trigger(Interval=2000, TimerInterval=2000, Target=c_script)
logos = BooleanToggle(True)
bitmap = BitmapFromFile(BitmapPath=str2img)  # -> Bitmap, Width, Height
c_script = CSharpScript()  # -> out, a, W, H
# ---------- c_script: C# ----------
// Grasshopper Script Instance
#region Usings
using System;
using System.Linq;
using System.Collections;
using System.Collections.Generic;
using System.Drawing;

using Rhino;
using Rhino.Geometry;

using Grasshopper;
using Grasshopper.Kernel;
using Grasshopper.Kernel.Data;
using Grasshopper.Kernel.Types;
#endregion

using System.IO;
using System.Data;
using System.Reflection;
using System.Windows.Forms;
using System.Xml;
using System.Xml.Linq;
using System.Runtime.InteropServices;

using Rhino.DocObjects;
using Rhino.Collections;

public class Script_Instance : GH_ScriptInstance
{
    #region Notes
    /* 
      Members:
        RhinoDoc RhinoDocument
        GH_Document GrasshopperDocument
        IGH_Component Component
        int Iteration

      Methods (Virtual & overridable):
        Print(string text)
        Print(string format, params object[] args)
        Reflect(object obj)
        Reflect(object obj, string method_name)
    */
    #endregion

    private void RunScript(ref object a, ref object W, ref object H)
    {
        var view = RhinoDoc.ActiveDoc.Views.ActiveView;
        H = view.ActiveViewport.Bounds.Height;
        W = view.ActiveViewport.Bounds.Width;
    }
}
# ---------- end c_script ----------
filter = StreamFilter(Gate=logos, Stream1=bitmap.Bitmap)
subtraction = Subtraction(A=c_script.W, B="30")
subtraction_2 = Subtraction(A=c_script.H, B="30")
multiplication = Multiplication(A=c_script.W, B=".12")
pt = ConstructPoint(XCoordinate=subtraction, YCoordinate=subtraction_2, ZCoordinate=0)
c_script_2 = CSharpScript(Tx=filter, P=pt, w=multiplication)  # -> out, a; inputs P: Point3d, w: Double
# ---------- c_script_2: C# ----------
// Grasshopper Script Instance
#region Usings
using System;
using System.Linq;
using System.Collections;
using System.Collections.Generic;
using System.Drawing;

using Rhino;
using Rhino.Geometry;
using Rhino.DocObjects;
using Rhino.Collections;

using Grasshopper;
using Grasshopper.Kernel;
using Grasshopper.Kernel.Data;
using Grasshopper.Kernel.Types;
#endregion

using System;
using System.Drawing;
using System.Drawing.Drawing2D;
using System.Drawing.Imaging;
using System.IO;

public class Script_Instance : GH_ScriptInstance
{
    #region Notes
    /* 
      Members:
        RhinoDoc RhinoDocument
        GH_Document GrasshopperDocument
        IGH_Component Component
        int Iteration

      Methods (Virtual & overridable):
        Print(string text)
        Print(string format, params object[] args)
        Reflect(object obj)
        Reflect(object obj, string method_name)
    */
    #endregion

    private void RunScript(object Tx, Point3d P, double w, ref object a)
    {
        Bitmap texture = Tx as Bitmap;
        if (texture == null) return;

        int width = texture.Width;
        int height = texture.Height;

        double scale = w / ((double) width);

        texture = ResizeImage(texture, (int) (scale * width), (int) (scale * height));

        if (_bitmap == null)
            _bitmap = new Rhino.Display.DisplayBitmap(texture);

        _point.X = P.X - scale * width;
        _point.Y = P.Y - scale * height;
        _point.Z = 0.0;
    }

    private Rhino.Display.DisplayBitmap _bitmap;
    private Point3d _point;    
 
    public override void BeforeRunScript()
    {
        if (_bitmap != null)
        {
            _bitmap.Dispose();
            _bitmap = null;
        }
    }

    //Draw all meshes in this method.
    public override void DrawViewportMeshes(IGH_PreviewArgs args)
    {
        if (_bitmap == null) return;
 
        int x = (int) (_point.X);
        int y = (int) (_point.Y);
        args.Display.DrawBitmap(_bitmap, x, y);
    }

    /// Resize the image to the specified width and height.
    /// </summary>
    /// <param name="image">The image to resize.</param>
    /// <param name="width">The width to resize to.</param>
    /// <param name="height">The height to resize to.</param>
    /// <returns>The resized image.</returns>
    public static Bitmap ResizeImage(Image image, int width, int height)
    {
        var destRect = new Rectangle(0, 0, width, height);
        var destImage = new Bitmap(width, height);

        destImage.SetResolution(image.HorizontalResolution, image.VerticalResolution);

        using (var graphics = Graphics.FromImage(destImage))
        {
            graphics.CompositingMode = CompositingMode.SourceCopy;
            graphics.CompositingQuality = CompositingQuality.HighQuality;
            graphics.InterpolationMode = InterpolationMode.HighQualityBicubic;
            graphics.SmoothingMode = SmoothingMode.HighQuality;
            graphics.PixelOffsetMode = PixelOffsetMode.HighQuality;

            using (var wrapMode = new ImageAttributes())
            {
                wrapMode.SetWrapMode(WrapMode.TileFlipXY);
                graphics.DrawImage(image, destRect, 0, 0, image.Width,image.Height, GraphicsUnit.Pixel, wrapMode);
            }
        }

        return destImage;
    }    
}
# ---------- end c_script_2 ----------

# ---- group: STATISCHE DIAGRAMME
werte = BooleanToggle(False)
farbe_3 = ColourSwatch(SwatchColor=RGB(255, 255, 255))
farbe_4 = ColourSwatch(SwatchColor=RGBA(222, 11, 11, 100))
farbe_5 = ColourSwatch(SwatchColor=RGBA(11, 67, 222, 101))
farbe_6 = ColourSwatch(SwatchColor=RGBA(255, 255, 11, 100))
farbe_7 = ColourSwatch(SwatchColor=RGBA(27, 133, 0, 101))
normalkraft_n_kn = BooleanToggle(False)
querkraft_vy_kn = BooleanToggle(False)
querkraft_vz_kn = BooleanToggle(False)
moment_my_knm = BooleanToggle(False)
moment_mz_knm = BooleanToggle(False)
reduktion_n = Slider(102, range=1..1000)
reduktion_v = Slider(42, range=1..1000)
reduktion_m = Slider(52, range=1..1000)

# ---- group: SPANNUNGSRATIO
spannungsratio = BooleanToggle(False)
zum_maximum = BooleanToggle(False)
ratio_über_zeigen = Slider(0, range=0..100)
stahlgrad = Slider(3, range=1..4)
panel_4 = Panel("""S235
S275
S355
S450""")
panel_5 = Panel("""223.81
261.90
338.10
428.57""")
item = ListItem(List=panel_4, Index=expr("x-1", stahlgrad), Wrap=True)
item_2 = ListItem(List=panel_5, Index=expr("x-1", stahlgrad), Wrap=True)
entwine = Entwine(
    Branch00=ColourSwatch(SwatchColor=RGB(0, 0, 255)),
    Branch01=ColourSwatch(SwatchColor=RGB(0, 170, 255)),
    Branch02=ColourSwatch(SwatchColor=RGB(0, 255, 128)),
    Branch03=ColourSwatch(SwatchColor=RGB(128, 255, 0)),
    Branch04=ColourSwatch(SwatchColor=RGB(255, 255, 0)),
    Branch05=ColourSwatch(SwatchColor=RGB(255, 212, 0)),
    Branch06=ColourSwatch(SwatchColor=RGB(255, 128, 0)),
    Branch07=ColourSwatch(SwatchColor=RGB(255, 0, 0)),
    Branch08=ColourSwatch(SwatchColor=RGB(200, 0, 200)),
    FlattenInputs=True)
panel_6 = Panel(item_2)
eval = Evaluate(E="Format(\"Stahlgrad {0}\",x)", x=item)
flatten = FlattenTree(Tree=entwine, Path="{0}")
panel_7 = Panel(eval)

# ---- group: MATERIAL, LOKALE KOORDINATENSYSTEME (EBENEN), QUERSCHNITTSEIGENSCHAFTEN UND QUERSCHNITTE
# Für jeden Querschnitt muss man die geometrische Eigenschaften berechnen (Fläche, Trägheitsmoment, ...) Dazu kann man ein Pyhton Komponent benutzen.
# Für die 6DOF Stäbe (Normalkraft und Biegemomente) muss man den Beam 6DOF Komponent von K2Engineering benutzen.
# 
# Für die 3DOF Stäbe (nur Normalkraft, das heisst, Zug oder Druckstäbe) muss man den Bar 3DOF Komponent von K2Engineering benutzen.
# Die Material und Queschnittseigenschaften werden zu den Stabsegmente zugewiesen.
# Man bekommt alle Stabsegmente zusammen, und die die Anzahl der Unterteilungen, kann man die verschieden Stäbe unterscheiden.
# 
# Man muss dieselbe Reihenfolge beachten als bei der vorherigen Verbidung.
# Für den Träger, zum Beispiel, ein rechteckiger Hohlprofil
# Jedes Stabsegment muss ein lokales Koordinatensystem zugewiesen werden. Das erzeugt der BeamOrientation Komponente von K2Engineering.
# Für die Stützen, zum Beispiel, ein rundformiger Hohlprofil
# Materilien können für jeden Querschnitt anders definiert werden.
# In diesem Beispiel, alle sind Stahl-Elemente.
# Für die Diagonal, zum Beispiel, ein Blech
# Für das Stabelement (BAR 3DOF) der Diagonal (Zug und Druckstäbe), ist es nicht nötig für die Berechnung, denn es braucht nur die Fläche, und das hängt nicht vom lokalen Koordinatensystem ab. Aber, wenn man die 3D darstellung erzeugen will, dann braucht man es
panel_8 = Panel("""S355
Material
[N/mm2]
[MPa]""")
panel_9 = Panel("DICHTE [kN/m3]")
panel_10 = Panel("78.5")
fyk_mpa = Number("355")
g_mpa = Number("8.5e4")
e_mpa = Number("2.1e5")
panel_11 = Panel("""300.0
100.0
10.0
100.0
10.0
50.0
10.0""")
reset_querschnitte = Button()
durchmesser_d_mm = Slider(100, range=50..500)
höhe_h_mm = Slider(300, range=50..500)
breite_b_mm = Slider(100, range=50..500)
wandgrösse_t_mm = Slider(10, range=5..40)
wandgrösse_t_mm_2 = Slider(10, range=5..30)
höhe_h_mm_2 = Slider(50, range=5..200)
breite_b_mm_2 = Slider(10, range=5..20)
reset_2 = CSharpScript(
    Reset=reset_querschnitte,
    Parameters=[höhe_h_mm, breite_b_mm, wandgrösse_t_mm, durchmesser_d_mm, wandgrösse_t_mm_2, höhe_h_mm_2, breite_b_mm_2],
    Values=panel_11)  # -> out; inputs Reset: Boolean, Parameters: list, Values: list of Double; same code as reset
panel_12 = Panel(reset_2)
rechteck_hohlprofil = Python3Script(H=höhe_h_mm, B=breite_b_mm, t=wandgrösse_t_mm)  # -> out, A, Ip, Is, It, Wp, Ws; inputs H: Double, B: Double, t: Double
# ---------- rechteck_hohlprofil: Python ----------
import math

Hi = H - 2*t
Bi = B - 2*t

A = (B*H - Bi*Hi)
Ip = 1/12 * (B*H**3 - Bi*Hi**3)
Is = 1/12 * (B**3*H - Bi**3*Hi)
It = 1                              # Keine Torsion Steifigkeit, als Vereinfachung
Wp = Ip / (H/2)
Ws = Is / (B/2)
# ---------- end rechteck_hohlprofil ----------
kreis_hohlprofil = Python3Script(D=durchmesser_d_mm, t=wandgrösse_t_mm_2)  # -> out, A, Ip, Is, It, Wp, Ws
# ---------- kreis_hohlprofil: Python ----------
import math

Di = D - 2*t
A = 1/4 * math.pi * (D**2 - Di**2)
Ip = 1/64 * math.pi * (D**4 - Di**4)
Is = Ip
It = 1                              # Keine Torsion Steifigkeit, als Vereinfachung
Wp = Ip / (D/2)
Ws = Wp
# ---------- end kreis_hohlprofil ----------
rechteck_profil = Python3Script(H=höhe_h_mm_2, B=breite_b_mm_2)  # -> out, A, Ip, Is, It, Wp, Ws; inputs H: Double, B: Double
# ---------- rechteck_profil: Python ----------
import math

A = B*H
Ip = 1/12 * B*H**3
Is = 1/12 * B**3*H
It = 1                              # Keine Torsion Steifigkeit, als Vereinfachung
Wp = Ip / (H/2)
Ws = Is / (B/2)
# ---------- end rechteck_profil ----------
panel_13 = Panel("""Reihenfolge:
Träger
Stützen (x2)
Diagonal""")

# ----
widerstandsmoment_wp_mm3 = Number(rechteck_hohlprofil.Wp)
widerstandsmoment_ws_mm3 = Number(rechteck_hohlprofil.Ws)
widerstandsmoment_wp_mm3_2 = Number(kreis_hohlprofil.Wp)
widerstandsmoment_ws_mm3_2 = Number(kreis_hohlprofil.Ws)
fläche_a_mm2 = Number(rechteck_hohlprofil.A)
widerstandsmoment_wp_mm3_3 = Number(kreis_hohlprofil.Wp)
widerstandsmoment_ws_mm3_3 = Number(kreis_hohlprofil.Ws)
fläche_a_mm2_2 = Number(kreis_hohlprofil.A)
fläche_a_mm2_3 = Number(kreis_hohlprofil.A)
fläche_a_mm2_4 = Number(fläche_a_mm2)
widerstandsmoment_wp_mm3_4 = Number(widerstandsmoment_wp_mm3)
widerstandsmoment_ws_mm3_4 = Number(widerstandsmoment_ws_mm3)
fläche_a_mm2_5 = Number(fläche_a_mm2_3)
widerstandsmoment_wp_mm3_5 = Number(widerstandsmoment_wp_mm3_3)
widerstandsmoment_ws_mm3_5 = Number(widerstandsmoment_ws_mm3_3)
widerstandsmoment_wp_mm3_6 = Number(widerstandsmoment_wp_mm3_2)
fläche_a_mm2_6 = Number(fläche_a_mm2_2)
widerstandsmoment_ws_mm3_6 = Number(widerstandsmoment_ws_mm3_2)

# ---- group: LASTEN
# Zulezt, soll man den Betrag der Kraft in einen Vektor verwandeln, damit die Richtung der Kraft definiert wird. Die vertikale Lasten sind normallerweise nach unten gerichtet (daher der Negativ Komponente).
# Kangaroo kann keine Strekenlasten behandeln, so dass es nötig ist, sie in Punktlasten zu verwandeln, in dem man die Einflusslänge betrachtet.
# Punktlasten aus K2Engineering müssen in [N] sein.
# Man soll die Endpunkte (externen) von den internen Punkten trennen, denn an den Enden soll die Hälfte der Last zugewiesen werden als an den internen Punkten.
# Die gleiche Reihenfolge in Kräfte und Punkte
# damit die Darstellung korrekt ist.
streckenlast_auf_träger_cd_q_kn_m2 = Slider(20, range=0..50)
horizontaler_punktlast_auf_c_kn = Slider(50, range=0..100)
spannweite_l_m_2 = Number(spannweite_l_m)
panel_14 = Panel("""20.0
50.0""")
reset_lasten = Button()
reset_3 = CSharpScript(Reset=reset_lasten, Parameters=[streckenlast_auf_träger_cd_q_kn_m2, horizontaler_punktlast_auf_c_kn], Values=panel_14)  # -> out; inputs Reset: Boolean, Parameters: list, Values: list of Double; same code as reset
panel_15 = Panel(reset_3)

# ---- group: PUNKT- UND STABELEMENTE DER GEOMETRIE
# BEAM 6DOF Elemente müssen unterteilt werden. Auch die Elemente die "lineare" Lasten tragen müssen, weil Kangaroo kann nur Punktlasten betrachten.
# 
# BAR 3DOF Elemente (Druck oder Zugstäbe) müssen nicht unterteilt werden.
# Die unterteilte Linien müssen in Polylinien zusammen erstellt,
# die dann in Segmente explodiert werden.
# Nur die Diagonal (BAR 3DOF) muss nicht unterteilt, "zusammengeklebt" und dann explodiert werden.
# Die Geometrie aller Segmente werden hier zusammen gespeichert.
# Reihenfolge:
# Träger
# Stützen (x2)
# Diagonal
# AC - STÜTZE (BEAM 6DOF)
# BD - STÜTZE (BEAM 6DOF)
# CD - TRÄGER (BEAM 6DOF)
# AD - DIAGONAL (BAR 3DOF)
panel_16 = Panel("""GEOMETRIE
PUNKTE UND LINIEN""")
A = ConstructPoint(XCoordinate=0, YCoordinate=0, ZCoordinate=0)
B = ConstructPoint(XCoordinate=spannweite_l_m, YCoordinate=0, ZCoordinate=0)
C = ConstructPoint(XCoordinate=0, YCoordinate=0, ZCoordinate=höhe_h_m)
D = ConstructPoint(XCoordinate=spannweite_l_m, YCoordinate=0, ZCoordinate=höhe_h_m)
anzahl_unterteilung_träger_nt = Slider(8, range=1..10)
ac = Line(StartPoint=A, EndPoint=C)
cd = Line(StartPoint=C, EndPoint=D)
bd = Line(StartPoint=B, EndPoint=D)
cd_2 = Line(StartPoint=A, EndPoint=D)
end = EndPoints(Curve=cd_2)  # -> Start, End
flatten_2 = FlattenTree(Tree=[end.Start, end.End], Path="{0}")
divide = DivideCurve(Curve=ac, Count=anzahl_unterteilung_stütze_ns, Kinks=False)  # -> Points, Tangents, Parameters
divide_2 = DivideCurve(Curve=cd, Count=anzahl_unterteilung_träger_nt, Kinks=False)  # -> Points, Tangents, Parameters
divide_3 = DivideCurve(Curve=bd, Count=anzahl_unterteilung_stütze_ns, Kinks=False)  # -> Points, Tangents, Parameters
pline = PolyLine(Vertices=divide.Points, Closed=False)
pline_2 = PolyLine(Vertices=divide_2.Points, Closed=False)
pline_3 = PolyLine(Vertices=divide_3.Points, Closed=False)
diagonal = Line(cd_2)
explode = Explode(Curve=pline, Recursive=True)  # -> Segments, Vertices
explode_2 = Explode(Curve=pline_2, Recursive=True)  # -> Segments, Vertices
explode_3 = Explode(Curve=pline_3, Recursive=True)  # -> Segments, Vertices
reset_unterteilung = Button()
panel_17 = Panel("""5
2""")
flatten_3 = FlattenTree(Tree=[divide.Points, divide_2.Points, divide_3.Points], Path="{0}")
reset_4 = CSharpScript(Reset=reset_unterteilung, Parameters=[anzahl_unterteilung_träger_nt, anzahl_unterteilung_stütze_ns], Values=panel_17)  # -> out; inputs Reset: Boolean, Parameters: list, Values: list of Int32
# ---------- reset_4: C# ----------
// Grasshopper Script Instance
#region Usings
using System;
using System.Linq;
using System.Collections;
using System.Collections.Generic;
using System.Drawing;

using Rhino;
using Rhino.Geometry;

using Grasshopper;
using Grasshopper.Kernel;
using Grasshopper.Kernel.Data;
using Grasshopper.Kernel.Types;
#endregion

public class Script_Instance : GH_ScriptInstance
{
    #region Notes
    /* 
      Members:
        RhinoDoc RhinoDocument
        GH_Document GrasshopperDocument
        IGH_Component Component
        int Iteration

      Methods (Virtual & overridable):
        Print(string text)
        Print(string format, params object[] args)
        Reflect(object obj)
        Reflect(object obj, string method_name)
    */
    #endregion

    private void RunScript(bool Reset, List<object> Parameters, List<int> Values)
    {
        Grasshopper.Kernel.Special.GH_NumberSlider slider;

        int num_sliders = Parameters.Count();
        int num_values = Values.Count();

        if (num_sliders != num_values)
            Print("Error: Parameters and Values should match in number of elements");
        else
        {    
            int i;

            if (Reset == true)
            {
                Print("Reseting to default values");

                for (i = 0; i < num_sliders ; i++)
                {
                    slider = Component.Params.Input[1].Sources[i] as Grasshopper.Kernel.Special.GH_NumberSlider; //try to cast that thing as a slider

                    if (slider != null)
                    {
                        slider.TrySetSliderValue((int) Values[i]);
                    }
                }
            }
        }
    }
}
# ---------- end reset_4 ----------
flatten_4 = FlattenTree(Tree=[flatten_3, flatten_2], Path="{0}")
panel_18 = Panel(reset_4)
alle_punkte = Point(flatten_4)

# ---- group: AULFAGER
# Die Auflager werden zu Punkten der Geometrie zugewiesen.
# Hier ist jede Auflager unabhängig. Wenn zwei Auflager sich identisch definieren, können mehrere Punkte auf den pt Eingabe verknüpft werden.
# "Toggle buttons" damit man die Bewegungverhinderung ein- oder ausschalten kann.
# Support6DOF
# von K2Engineering
# 
# Der andere Art ist Support, der nur die Verschiebungen verhindern kann (nicht die Drehungen). Das gilt für gelenkige Auflager, aber mit dem Support6DOF kann auch ein gelenkiges Auflager definiert werden, indem man die RX, RY und/oder RZ frei stellt.
reset_auflager = Button()
auflager_a = Point(A)
auflager_b = Point(B)
dxa = BooleanToggle(True)
rya = BooleanToggle(True)
dxb = BooleanToggle(True)
ryb = BooleanToggle(True)
reset_5 = CSharpScript(Reset=reset_auflager, Parameters=[dxa, rya, dxb, ryb])  # -> out; inputs Reset: Boolean, Parameters: list
# ---------- reset_5: C# ----------
// Grasshopper Script Instance
#region Usings
using System;
using System.Linq;
using System.Collections;
using System.Collections.Generic;
using System.Drawing;

using Rhino;
using Rhino.Geometry;

using Grasshopper;
using Grasshopper.Kernel;
using Grasshopper.Kernel.Data;
using Grasshopper.Kernel.Types;
#endregion

public class Script_Instance : GH_ScriptInstance
{
    #region Notes
    /* 
      Members:
        RhinoDoc RhinoDocument
        GH_Document GrasshopperDocument
        IGH_Component Component
        int Iteration

      Methods (Virtual & overridable):
        Print(string text)
        Print(string format, params object[] args)
        Reflect(object obj)
        Reflect(object obj, string method_name)
    */
    #endregion

    private void RunScript(bool Reset, List<object> Parameters)
    {
        Grasshopper.Kernel.Special.GH_BooleanToggle button;
        int num_buttons = Parameters.Count();

        int i;

        if (Reset == true)
        {
            Print("Reseting to default values");
            
            for (i = 0; i < num_buttons ; i++)
            {
                button = Component.Params.Input[1].Sources[i] as Grasshopper.Kernel.Special.GH_BooleanToggle; //try to cast that thing as a boolean toggle

                if (button != null)
                {
                    button.Value = true;
                    button.ExpireSolution(true);
                }
            }
        }
    }
}
# ---------- end reset_5 ----------
support6dof_b = Support6DOF(SupportPt=auflager_b, XFixed=dxb, YFixed=True, ZFixed=True, RXFixed=True, RYFixed=ryb, RZFixed=True, Strength=1e+12)
support6dof_a = Support6DOF(SupportPt=auflager_a, XFixed=dxa, YFixed=True, ZFixed=True, RXFixed=True, RYFixed=rya, RZFixed=True, Strength=1e+12)
panel_19 = Panel(reset_5)
auflager = FlattenTree(Tree=[support6dof_a, support6dof_b], Path="{0}")

# ----
flatten_tree = FlattenTree(Tree=explode.Segments, Path="{0}")
flatten_tree_2 = FlattenTree(Tree=explode_2.Segments, Path="{0}")
flatten_tree_3 = FlattenTree(Tree=explode_3.Segments, Path="{0}")

# ---- group: PUNKT- UND STABELEMENTE DER GEOMETRIE (continued)
flatten_5 = FlattenTree(Tree=[flatten_tree_2, flatten_tree, flatten_tree_3], Path="{0}")
flatten_6 = FlattenTree(Tree=[flatten_5, diagonal], Path="{0}")
alle_stäbe = Curve(flatten_6)

# ---- group: MATERIAL, LOKALE KOORDINATENSYSTEME (EBENEN), QUERSCHNITTSEIGENSCHAFTEN UND QUERSCHNITTE (continued)
alle_stäbe_2 = Curve(alle_stäbe)
anzahl_unterteilung_träger_nt_2 = Integer(anzahl_unterteilung_träger_nt)
split = SplitList(List=alle_stäbe_2, Index=anzahl_unterteilung_träger_nt_2)  # -> ListA, ListB
split_2 = SplitList(List=split.ListB, Index=anzahl_unterteilung_stütze_ns_2)  # -> ListA, ListB
split_3 = SplitList(List=split_2.ListB, Index=anzahl_unterteilung_stütze_ns_2)  # -> ListA, ListB

# ----
träger_cd = FlattenTree(Tree=split.ListA, Path="{0}")
stütze_ac = FlattenTree(Tree=split_2.ListA, Path="{0}")
stütze_bd = FlattenTree(Tree=split_3.ListA, Path="{0}")
diagonal_ad = FlattenTree(Tree=split_3.ListB, Path="{0}")
beamorientation_stütze_bd = BeamOrientation(Line=stütze_bd, FlipVertical=True)  # -> StartPlane, EndPlane
beam6dof_stütze_b = Beam(
    StartPlane=beamorientation_stütze_bd.StartPlane,
    EndPlane=beamorientation_stütze_bd.EndPlane,
    EModulus=e_mpa,
    GModulus=g_mpa,
    A=kreis_hohlprofil.A,
    Iy=kreis_hohlprofil.Ip,
    Iz=kreis_hohlprofil.Is,
    It=kreis_hohlprofil.It)
flatten_7 = FlattenTree(Tree=beam6dof_stütze_b, Path="{0}")
anfebstützebd = Plane(beamorientation_stütze_bd.StartPlane)
endebstützebd = Plane(beamorientation_stütze_bd.EndPlane)

anfeb = Plane(anfebstützebd)
endeb = Plane(endebstützebd)

# ---- group: LASTEN (continued)
anzahl_unterteilung = Integer(anzahl_unterteilung_träger_nt)
punkte_auf_träger_cd = Point(explode_2.Vertices)
division = Division(A=spannweite_l_m_2, B=anzahl_unterteilung)
multiplication_2 = Multiplication(A=streckenlast_auf_träger_cd_q_kn_m2, Li=division)
cull_letzter_pkt = CullIndex(List=punkte_auf_träger_cd, Indices=anzahl_unterteilung, Wrap=True)
neg = Negative(Value=multiplication_2)
cull_erster_pkt = CullIndex(List=cull_letzter_pkt, Indices=0, Wrap=True)
division_2 = Division(Pi=neg, B=2)
erster_pkt = ListItem(List=punkte_auf_träger_cd, Index=0, Wrap=True)
letzter_pkt = ListItem(List=punkte_auf_träger_cd, Index=-1, Wrap=True)
kn_zu_n = Multiplication(A=division_2, B=1000)
kn_zu_n_2 = Multiplication(A=neg, B=1000)
flatten_8 = FlattenTree(Tree=[erster_pkt, letzter_pkt], Path="{0}")
externe_punkte = Point(flatten_8)
Z = UnitZ(Factor=kn_zu_n)
interne_punkte = Point(cull_erster_pkt)
Z_2 = UnitZ(Factor=kn_zu_n_2)
pi_ext = Load(Point=externe_punkte, NodalForce=Z)
pi_int = Load(Point=interne_punkte, NodalForce=Z_2)

# ---- group: MATERIAL, LOKALE KOORDINATENSYSTEME (EBENEN), QUERSCHNITTSEIGENSCHAFTEN UND QUERSCHNITTE (continued)
beamorientation_träger = BeamOrientation(Line=träger_cd, FlipVertical=False)  # -> StartPlane, EndPlane
beamorientation_stütze_ac = BeamOrientation(Line=stütze_ac, FlipVertical=True)  # -> StartPlane, EndPlane
beamorientation_diagonal = BeamOrientation(Line=diagonal_ad, FlipVertical=False)  # -> StartPlane, EndPlane
beam6dof_träger = Beam(
    StartPlane=beamorientation_träger.StartPlane,
    EndPlane=beamorientation_träger.EndPlane,
    EModulus=e_mpa,
    GModulus=g_mpa,
    A=rechteck_hohlprofil.A,
    Iy=rechteck_hohlprofil.Ip,
    Iz=rechteck_hohlprofil.Is,
    It=rechteck_hohlprofil.It)
beam6dof_stütze_ac = Beam(
    StartPlane=beamorientation_stütze_ac.StartPlane,
    EndPlane=beamorientation_stütze_ac.EndPlane,
    EModulus=e_mpa,
    GModulus=g_mpa,
    A=kreis_hohlprofil.A,
    Iy=kreis_hohlprofil.Ip,
    Iz=kreis_hohlprofil.Is,
    It=kreis_hohlprofil.It)
bar_3dof_diagonal = Bar(Line=diagonal_ad, EModulus=e_mpa, Area=rechteck_profil.A)

# ----
flatten_9 = FlattenTree(Tree=beam6dof_träger, Path="{0}")
flatten_10 = FlattenTree(Tree=beam6dof_stütze_ac, Path="{0}")
flatten_11 = FlattenTree(Tree=bar_3dof_diagonal, Path="{0}")

# ---- group: MATERIAL, LOKALE KOORDINATENSYSTEME (EBENEN), QUERSCHNITTSEIGENSCHAFTEN UND QUERSCHNITTE (continued)
stäbe = FlattenTree(Tree=[flatten_9, flatten_10, flatten_7, flatten_11], Path="{0}")

# ----
endebcd = Plane(beamorientation_träger.EndPlane)
anfebcd = Plane(beamorientation_träger.StartPlane)
endebdiagonal = Plane(beamorientation_diagonal.EndPlane)
anfebdiagonal = Plane(beamorientation_diagonal.StartPlane)
endebstützeac = Plane(beamorientation_stütze_ac.EndPlane)
anfebstützeac = Plane(beamorientation_stütze_ac.StartPlane)

anfebdiagonal_2 = Plane(anfebdiagonal)
endebdiagonal_2 = Plane(endebdiagonal)

anfeb_2 = Plane(anfebcd)
endeb_2 = Plane(endebcd)

anfeb_3 = Plane(anfebstützeac)
endeb_3 = Plane(endebstützeac)

# ---- group: LASTEN DARSTELLUNG
lasten_darstellen = BooleanToggle(False)
lasten_grössenfaktor = Slider(4, range=1..10)
subtraction_3 = Subtraction(A=1, B="0.7")
panel_20 = Panel(subtraction_3)
_1x10_5_b = Division(A=100000, B=lasten_grössenfaktor)

# ----
kn_zu_n_3 = Multiplication(A=horizontaler_punktlast_auf_c_kn, B=1000)
punkt_d = Point(D)
long = LongestList(ListA=Z, ListB=externe_punkte, PaddingMode=2)  # -> ListA, ListB
long_2 = LongestList(ListA=Z_2, ListB=interne_punkte, PaddingMode=2)  # -> ListA, ListB
flatten_12 = FlattenTree(Tree=pi_ext, Path="{0}")
flatten_13 = FlattenTree(Tree=pi_int, Path="{0}")

# ---- group: LASTEN (continued)
X = UnitX(Factor=kn_zu_n_3)
fx = Load(Point=punkt_d, NodalForce=X)

# ----
long_3 = LongestList(ListA=X, ListB=punkt_d, PaddingMode=2)  # -> ListA, ListB
flatten_14 = FlattenTree(Tree=fx, Path="{0}")

# ---- group: LASTEN (continued)
punkte = Point([long.ListB, long_2.ListB, long_3.ListB])
kräfte = Vector([long.ListA, long_2.ListA, long_3.ListA])
lasten = FlattenTree(Tree=[flatten_12, flatten_13, flatten_14], Path="{0}")

# ---- group: LASTEN DARSTELLUNG (continued)
kräfte_2 = Vector(flatten(kräfte))
punkte_2 = Point(flatten(punkte))
division_3 = Division(A=kräfte_2, B=_1x10_5_b)
vlen = VectorLength(Vector=division_3)
pl = PlaneNormal(Origin=Point(0, 0, 0), ZAxis=division_3)
multiplication_3 = Multiplication(A="0.7", B=vlen)
multiplication_4 = Multiplication(A=division_3, B="0.7")
pl_2 = PlaneNormal(Origin=multiplication_4, ZAxis=division_3)
multiplication_5 = Multiplication(A=vlen, B=panel_20)
cyl = Cylinder(Base=pl, Radius="0.03", Length=multiplication_3)
cone = Cone(Base=pl_2, Radius="0.15", Length=multiplication_5)  # -> Cone, Tip
move = Move(Geometry=cyl, Motion=punkte_2)  # -> Geometry, Transform
move_2 = Move(Geometry=cone.Cone, Motion=punkte_2)  # -> Geometry, Transform
geo = Geometry([move.Geometry, move_2.Geometry])
filter_2 = StreamFilter(Gate=lasten_darstellen, Stream1=geo)
preview = CustomPreview(Geometry=filter_2, Material=ColourSwatch(SwatchColor=RGB(255, 154, 0)))

# ----
entwine_2 = Entwine(Branch00=auflager, Branch01=stäbe, Branch02=lasten, FlattenInputs=True)

# ---- group: SOLVER MODUL
# SOLVER MODUL (KANGAROO)
# 
# Hier werden alle Daten, die das Berechnungsmodell definieren, kombiniert und in den Kangaroo-Solver eingegeben, dessen Ergebnisse (Ausgang "O") für die individuelle Verarbeitung aufgeschlüsselt werden.
# 
# 
# Die Komponente "Entwine" erhält alle Eingabedaten und kombiniert sie, damit der Solver sie empfängt („GoalObjects“). Die Reihenfolge ist unerheblich, aber die Ergebnisse werden in derselben Reihenfolge empfangen, in der sie eingegeben wurden.
# 
# In diesem Fall wurden 3 Eingaben verwendet:
# 
# - [0] Die 2 Auflager
# 
# - [1] Alle 4 Stäbe
# 
# - [2] Die Punktlasten, die an den entsprechenden Knoten aufgebracht werden.
# 
# 
# Die Materialeigenschaften der Stäbe wurden in verschiedene Eingaben aufgeteilt, um die Ergebnisse einfacher zu verarbeiten. Die Auflager hätten auch in zwei verschiedene Eingaben aufgeteilt werden können, es wurde jedoch bevorzugt, sie zusammenzuhalten.
# 
# 
# Der Solver führt den iterativen Prozess durch, der zur Gleichgewichtslösung konvergieren sollte. Dazu wird ein "Trhreshold" verwendet. Die Toleranz dient dazu, nahe beieinander liegende Punkte zusammenzuführen. Der Solver kann mit dem entsprechenden Schalter angehalten werden (zugänglich über das Benutzersteuerfeld).
# 
# 
# Die Schaltfläche „RESET“ startet die Berechnung des „Solver“ neu. Dies muss bei jeder Änderung erfolgen. Um Änderungen zu erkennen, wird ein in Python programmierter Baustein verwendet, der die Daten aller veränderbaren Parameter empfängt und sie vorübergehend speichert, um bei Erkennung einer Änderung eine Neuberechnung des „Solver“ auszulösen. Die Neuberechnung kann auch durch Drücken der Schaltfläche „RESET“ ausgelöst werden.
flatten_15 = FlattenTree(
    Tree=[spannweite_l_m, höhe_h_m, anzahl_unterteilung_träger_nt, dxa, rya, dxb, ryb, höhe_h_mm, breite_b_mm, wandgrösse_t_mm, durchmesser_d_mm, wandgrösse_t_mm_2, höhe_h_mm_2, breite_b_mm_2, streckenlast_auf_träger_cd_q_kn_m2, horizontaler_punktlast_auf_c_kn, anzahl_unterteilung_stütze_ns],
    Path="{0}")
reset_6 = Button()
pause = BooleanToggle(False)
py3 = Python3Script(CurrentValue=flatten_15)  # -> out, SavedValue, isNewValue; inputs CurrentValue: list
# ---------- py3: Python ----------
# Instantiate or reset persistent data 
if "savedValue" not in globals():
    savedValue = CurrentValue

# Check current value persistent data
if CurrentValue == savedValue:
    isNewValue = False
else:
    isNewValue = True
    savedValue = CurrentValue
    ghenv.Component.ExpireSolution(True)

# Output to GH
SavedValue = savedValue
# ---------- end py3 ----------
or = GateOr(A=py3.isNewValue, B=reset_6)
not = GateNot(A=pause)
solver = Solver(GoalObjects=entwine_2, Reset=or, Threshold="1e-15", Tolerance=1e-05, On=not)  # -> I, V, O
bang = ExplodeTree(Data=solver.O)  # -> Branch0, Branch1, Branch2

# ---- group: SORTIERUNG DER STAB ERGEBNISSE
# Reihenfolge:
# Träger (Nt)
# Stützen (2xNs)
# Diagonal (1)
anzahl_unterteilung_träger_nt_3 = Integer(anzahl_unterteilung_träger_nt)
anzahl_unterteilung_stütze_ns_3 = Integer(anzahl_unterteilung_stütze_ns)
träger_in_a = SplitList(List=bang.Branch1, Index=anzahl_unterteilung_träger_nt_3)  # -> ListA, ListB
stütze_ac_in_a = SplitList(List=träger_in_a.ListB, Index=anzahl_unterteilung_stütze_ns_3)  # -> ListA, ListB
stütze_bd_in_a_und_diagonal_in_b = SplitList(List=stütze_ac_in_a.ListB, Index=anzahl_unterteilung_stütze_ns_3)  # -> ListA, ListB

# ----
# Das ist neu programmiert (im Vergleich zu Übung 1), um es leichter zu benutzen auf anderen Beispielen.
# 
# Alles in dieser Gruppe kann kopiert werden, um die Ergebnise einer anderen Stab (BEAM 6DOF) darzustellen.
# 
# Es müssen nur die Eingabedaten verknüpft werden:
# 1. Anfangs- und EndEbenen
# 2. Ergebnis aus den Solver
# 3. Querschnittseigenschaften für Spannungsratio
# 
# Alles andere bleibt intern un ermöglicht die Darstellung alle Ergenisse einer BEAM 6DOF: Verformung, Normalkraft, Querkräfte, Momente, und Spannungsratio.
beamoutput_träger_cd = BeamOutput(BeamData=träger_in_a.ListA)  # -> P0, P1, N, Vy, Vz, Mt, My0, Mz0, My1, Mz1

# ---- group: VERFORMUNG
deplane = DeconstructPlane(Plane=anfeb_2)  # -> Origin, XAxis, YAxis, ZAxis
deplane_2 = DeconstructPlane(Plane=endeb_2)  # -> Origin, XAxis, YAxis, ZAxis
deplane_3 = DeconstructPlane(Plane=beamoutput_träger_cd.P0)  # -> Origin, XAxis, YAxis, ZAxis
deplane_4 = DeconstructPlane(Plane=beamoutput_träger_cd.P1)  # -> Origin, XAxis, YAxis, ZAxis
subtraction_4 = Subtraction(A=deplane_3.Origin, B=deplane.Origin)
subtraction_5 = Subtraction(A=deplane_4.Origin, B=deplane_2.Origin)
letzte = ListItem(List=deplane_2.Origin, Index=-1, Wrap=True)
letzte_2 = ListItem(List=subtraction_5, Index=-1, Wrap=True)
flatten_16 = FlattenTree(Tree=[deplane.Origin, letzte], Path="{0}")
flatten_17 = FlattenTree(Tree=[subtraction_4, letzte_2], Path="{0}")
m_zu_mm = Multiplication(A=flatten_17, B=1000)
multiplication_6 = Multiplication(A=flatten_17, B=faktor)
pdecon = Deconstruct(Point=m_zu_mm)  # -> XComponent, YComponent, ZComponent
addition = Addition(A=flatten_16, B=multiplication_6)
eval_2 = Evaluate(
    E="Format(\"({0},{1},{2})\",Round(x,n),Round(y,n),Round(z,n))",
    x=pdecon.XComponent,
    y=pdecon.YComponent,
    z=pdecon.ZComponent,
    n=nachkommastellen)
intcrv = Interpolate(Vertices=addition, Degree=4, Periodic=False, KnotStyle=1)  # -> Curve, Length, Domain
and = GateAnd(A=wireframe_verformung, B=werte_der_bewegungen_mm)
filter_3 = StreamFilter(Gate=and, Stream1=eval_2)
filter_4 = StreamFilter(Gate=wireframe_verformung, Stream1=intcrv.Curve)
preview_2 = CustomPreview(Geometry=filter_4, Material=farbe)
tag = TextTag(Location=addition, Text=filter_3, Colour=farbe_2)

# ---- group: NORMALKRAFT N
flatten_18 = FlattenTree(Tree=beamoutput_träger_cd.N, Path="{0}")
division_4 = Division(A=flatten_18, B=reduktion_n)
eval_3 = Evaluate(E="If(round(x,y)=0,\"\",If(round(x,y)>0,Format(\"+{0}\",round(x,y)),round(x,y)))", x=flatten_18, y=nachkommastellen)
pt_2 = PointOriented(BasePlane=endeb_2, UComponent=0, VComponent=0, WComponent=0)
pt_3 = PointOriented(BasePlane=endeb_2, UComponent=0, VComponent=division_4, WComponent=0)
pt_4 = PointOriented(BasePlane=anfeb_2, UComponent=0, VComponent=division_4, WComponent=0)
pt_5 = PointOriented(BasePlane=anfeb_2, UComponent=0, VComponent=0, WComponent=0)
ln = Line(StartPoint=pt_3, EndPoint=pt_4)
midpt = CurveMiddle(Curve=ln)
srf4pt = _4PointSurface(CornerA=pt_2, CornerB=pt_3, CornerC=pt_4, CornerD=pt_5)
and_2 = GateAnd(A=normalkraft_n_kn, B=werte)
filter_5 = StreamFilter(Gate=and_2, Stream1=eval_3)
filter_6 = StreamFilter(Gate=normalkraft_n_kn, Stream1=srf4pt)
smaller = SmallerThan(FirstNumber=division_4, SecondNumber=0)  # -> SmallerThan, OrEqualTo
dispatch = Dispatch(List=filter_6, DispatchPattern=smaller.SmallerThan)  # -> ListA, ListB
preview_3 = CustomPreview(Geometry=dispatch.ListA, Material=farbe_4)
preview_4 = CustomPreview(Geometry=dispatch.ListB, Material=farbe_6)
tag_2 = TextTag(Location=midpt, Text=filter_5, Colour=farbe_3)

# ---- group: QUERKRAFT Vy
flatten_19 = FlattenTree(Tree=beamoutput_träger_cd.Vy, Path="{0}")
division_5 = Division(A=flatten_19, B=reduktion_v)
eval_4 = Evaluate(E="If(round(x,y)=0,\"\",If(round(x,y)>0,Format(\"+{0}\",round(x,y)),round(x,y)))", x=flatten_19, y=nachkommastellen)
pt_6 = PointOriented(BasePlane=endeb_2, UComponent=0, VComponent=0, WComponent=0)
pt_7 = PointOriented(BasePlane=endeb_2, UComponent=division_5, VComponent=0, WComponent=0)
pt_8 = PointOriented(BasePlane=anfeb_2, UComponent=division_5, VComponent=0, WComponent=0)
pt_9 = PointOriented(BasePlane=anfeb_2, UComponent=0, VComponent=0, WComponent=0)
ln_2 = Line(StartPoint=pt_7, EndPoint=pt_8)
midpt_2 = CurveMiddle(Curve=ln_2)
srf4pt_2 = _4PointSurface(CornerA=pt_6, CornerB=pt_7, CornerC=pt_8, CornerD=pt_9)
and_3 = GateAnd(A=querkraft_vy_kn, B=werte)
filter_7 = StreamFilter(Gate=and_3, Stream1=eval_4)
filter_8 = StreamFilter(Gate=querkraft_vy_kn, Stream1=srf4pt_2)
preview_5 = CustomPreview(Geometry=filter_8, Material=farbe_7)
tag_3 = TextTag(Location=midpt_2, Text=filter_7, Colour=farbe_3)

# ---- group: MOMENT My
flatten_20 = FlattenTree(Tree=beamoutput_träger_cd.My1, Path="{0}")
flatten_21 = FlattenTree(Tree=beamoutput_träger_cd.My0, Path="{0}")
neg_2 = Negative(Value=flatten_21)
division_6 = Division(A=flatten_20, B=reduktion_m)
division_7 = Division(A=neg_2, B=reduktion_m)
pt_10 = PointOriented(BasePlane=endeb_2, UComponent=0, VComponent=0, WComponent=0)
pt_11 = PointOriented(BasePlane=endeb_2, UComponent=0, VComponent=division_6, WComponent=0)
pt_12 = PointOriented(BasePlane=anfeb_2, UComponent=0, VComponent=division_7, WComponent=0)
pt_13 = PointOriented(BasePlane=anfeb_2, UComponent=0, VComponent=0, WComponent=0)
ln_3 = Line(StartPoint=pt_10, EndPoint=pt_13)
ln_4 = Line(StartPoint=pt_11, EndPoint=pt_12)
ccx = CurveCurve(CurveA=ln_3, CurveB=ln_4)  # -> Points, ParamsA, ParamsB
item_3 = ListItem(List=flatten_20, Index=-1, Wrap=True)
item_4 = ListItem(List=pt_11, Index=-1, Wrap=True)
flatten_22 = FlattenTree(Tree=ccx.Points, Path="{0}")
neg_3 = Negative(Value=item_3)
srf4pt_3 = _4PointSurface(CornerA=pt_10, CornerB=pt_11, CornerC=flatten_22)
srf4pt_4 = _4PointSurface(CornerA=pt_13, CornerB=flatten_22, CornerC=pt_12)
srf4pt_5 = _4PointSurface(CornerA=pt_10, CornerB=pt_11, CornerC=pt_12, CornerD=pt_13)
multiplication_7 = Multiplication(A=division_6, B=division_7)
flatten_23 = FlattenTree(Tree=[flatten_21, neg_3], Path="{0}")
flatten_24 = FlattenTree(Tree=[pt_12, item_4], Path="{0}")
larger = LargerThan(FirstNumber=multiplication_7, SecondNumber=0)  # -> LargerThan, OrEqualTo
not_2 = GateNot(A=larger.LargerThan)
and_4 = GateAnd(A=moment_my_knm, B=werte)
eval_5 = Evaluate(E="If(round(x,y)=0,\"\",If(round(x,y)>0,Format(\"+{0}\",round(x,y)),round(x,y)))", x=flatten_23, y=nachkommastellen)
dispatch_2 = Dispatch(List=srf4pt_3, DispatchPattern=not_2)  # -> ListA, ListB
dispatch_3 = Dispatch(List=srf4pt_4, DispatchPattern=not_2)  # -> ListA, ListB
dispatch_4 = Dispatch(List=srf4pt_5, DispatchPattern=larger.LargerThan)  # -> ListA, ListB
filter_9 = StreamFilter(Gate=and_4, Stream1=eval_5)
srf = Surface([dispatch_2.ListA, dispatch_3.ListA, dispatch_4.ListA])
filter_10 = StreamFilter(Gate=moment_my_knm, Stream1=srf)
preview_6 = CustomPreview(Geometry=filter_10, Material=farbe_5)
tag_4 = TextTag(Location=flatten_24, Text=filter_9, Colour=farbe_3)

# ---- group: QUERKRAFT Vz
flatten_25 = FlattenTree(Tree=beamoutput_träger_cd.Vz, Path="{0}")
division_8 = Division(A=flatten_25, B=reduktion_v)
eval_6 = Evaluate(E="If(round(x,y)=0,\"\",If(round(x,y)>0,Format(\"+{0}\",round(x,y)),round(x,y)))", x=flatten_25, y=nachkommastellen)
pt_14 = PointOriented(BasePlane=endeb_2, UComponent=0, VComponent=0, WComponent=0)
pt_15 = PointOriented(BasePlane=endeb_2, UComponent=0, VComponent=division_8, WComponent=0)
pt_16 = PointOriented(BasePlane=anfeb_2, UComponent=0, VComponent=division_8, WComponent=0)
pt_17 = PointOriented(BasePlane=anfeb_2, UComponent=0, VComponent=0, WComponent=0)
ln_5 = Line(StartPoint=pt_15, EndPoint=pt_16)
midpt_3 = CurveMiddle(Curve=ln_5)
srf4pt_6 = _4PointSurface(CornerA=pt_14, CornerB=pt_15, CornerC=pt_16, CornerD=pt_17)
and_5 = GateAnd(A=querkraft_vz_kn, B=werte)
filter_11 = StreamFilter(Gate=and_5, Stream1=eval_6)
filter_12 = StreamFilter(Gate=querkraft_vz_kn, Stream1=srf4pt_6)
preview_7 = CustomPreview(Geometry=filter_12, Material=farbe_7)
tag_5 = TextTag(Location=midpt_3, Text=filter_11, Colour=farbe_3)

# ---- group: SPANNUNGSRATIO
ln_6 = Line(StartPoint=anfeb_2, EndPoint=endeb_2)
normal_spannung = Python3Script(
    N=beamoutput_träger_cd.N,
    My0=beamoutput_träger_cd.My0,
    Mz0=beamoutput_träger_cd.Mz0,
    My1=beamoutput_träger_cd.My1,
    Mz1=beamoutput_träger_cd.Mz1,
    A=fläche_a_mm2_4,
    Wp=widerstandsmoment_wp_mm3_4,
    Ws=widerstandsmoment_ws_mm3_4)  # -> out, S0, S1
# ---------- normal_spannung: Python ----------
""" Normal Spannung berechnung"""

"Einheiten von kNm zu Nmm"
"Dazu noch, den absoluten Wert"
N = abs(N) * 1e3
My0 = abs(My0) * 1e6
Mz0 = abs(Mz0) * 1e6
My1 = abs(My1) * 1e6
Mz1 = abs(Mz1) * 1e6

S0 = N/A + My0/Wp + Mz0/Ws
S1 = N/A + My1/Wp + Mz1/Ws
# ---------- end normal_spannung ----------
filter_13 = StreamFilter(Gate=zum_maximum, Stream0=panel_6)
division_9 = Division(A=normal_spannung.S0, B=filter_13)
division_10 = Division(A=normal_spannung.S1, B=filter_13)
multiplication_8 = Multiplication(A=division_10, B=7)
multiplication_9 = Multiplication(A=division_9, B=7)
round = Round(Number=multiplication_8)  # -> Nearest, Floor, Ceiling
round_2 = Round(Number=multiplication_9)  # -> Nearest, Floor, Ceiling
max = Maximum(A=division_9, B=division_10)
min = Minimum(A=round.Floor, B=8)
min_2 = Minimum(A=round_2.Floor, B=8)
max_2 = Maximum(A=min_2, B=min)
item_5 = ListItem(List=flatten, Index=max_2, Wrap=True)
eval_7 = Evaluate(E="If(round(100.0*x,Y)<z,\"\",Format(\"{0}%\",round(100.0*x,Y)))", x=max, y=nachkommastellen, z=ratio_über_zeigen)
pt_18 = PointOriented(BasePlane=anfeb_2, UComponent=0, VComponent="0.1", WComponent=0)
midpt_4 = CurveMiddle(Curve=ln_6)
vec2pt = Vector2Pt(PointA=anfeb_2, PointB=pt_18, Unitize=False)  # -> Vector, Length
filter_14 = StreamFilter(Gate=spannungsratio, Stream1=ln_6)
addition_2 = Addition(A=vec2pt.Vector, B=midpt_4)
filter_15 = StreamFilter(Gate=spannungsratio, Stream1=eval_7)
preview_8 = CustomPreview(Geometry=filter_14, Material=item_5)
tag_6 = TextTag(Location=addition_2, Text=filter_15, Colour=item_5)

# ----
beamoutput_träger_cd_2 = BeamOutput(BeamData=stütze_ac_in_a.ListA)  # -> P0, P1, N, Vy, Vz, Mt, My0, Mz0, My1, Mz1

# ---- group: VERFORMUNG
deplane_5 = DeconstructPlane(Plane=anfeb_3)  # -> Origin, XAxis, YAxis, ZAxis
deplane_6 = DeconstructPlane(Plane=endeb_3)  # -> Origin, XAxis, YAxis, ZAxis
deplane_7 = DeconstructPlane(Plane=beamoutput_träger_cd_2.P0)  # -> Origin, XAxis, YAxis, ZAxis
deplane_8 = DeconstructPlane(Plane=beamoutput_träger_cd_2.P1)  # -> Origin, XAxis, YAxis, ZAxis
subtraction_6 = Subtraction(A=deplane_7.Origin, B=deplane_5.Origin)
subtraction_7 = Subtraction(A=deplane_8.Origin, B=deplane_6.Origin)
letzte_3 = ListItem(List=deplane_6.Origin, Index=-1, Wrap=True)
letzte_4 = ListItem(List=subtraction_7, Index=-1, Wrap=True)
flatten_26 = FlattenTree(Tree=[deplane_5.Origin, letzte_3], Path="{0}")
flatten_27 = FlattenTree(Tree=[subtraction_6, letzte_4], Path="{0}")
m_zu_mm_2 = Multiplication(A=flatten_27, B=1000)
multiplication_10 = Multiplication(A=flatten_27, B=faktor)
pdecon_2 = Deconstruct(Point=m_zu_mm_2)  # -> XComponent, YComponent, ZComponent
addition_3 = Addition(A=flatten_26, B=multiplication_10)
eval_8 = Evaluate(
    E="Format(\"({0},{1},{2})\",Round(x,n),Round(y,n),Round(z,n))",
    x=pdecon_2.XComponent,
    y=pdecon_2.YComponent,
    z=pdecon_2.ZComponent,
    n=nachkommastellen)
intcrv_2 = Interpolate(Vertices=addition_3, Degree=4, Periodic=False, KnotStyle=1)  # -> Curve, Length, Domain
and_6 = GateAnd(A=wireframe_verformung, B=werte_der_bewegungen_mm)
filter_16 = StreamFilter(Gate=and_6, Stream1=eval_8)
filter_17 = StreamFilter(Gate=wireframe_verformung, Stream1=intcrv_2.Curve)
preview_9 = CustomPreview(Geometry=filter_17, Material=farbe)
tag_7 = TextTag(Location=addition_3, Text=filter_16, Colour=farbe_2)

# ---- group: NORMALKRAFT N
flatten_28 = FlattenTree(Tree=beamoutput_träger_cd_2.N, Path="{0}")
division_11 = Division(A=flatten_28, B=reduktion_n)
eval_9 = Evaluate(E="If(round(x,y)=0,\"\",If(round(x,y)>0,Format(\"+{0}\",round(x,y)),round(x,y)))", x=flatten_28, y=nachkommastellen)
pt_19 = PointOriented(BasePlane=endeb_3, UComponent=0, VComponent=0, WComponent=0)
pt_20 = PointOriented(BasePlane=endeb_3, UComponent=0, VComponent=division_11, WComponent=0)
pt_21 = PointOriented(BasePlane=anfeb_3, UComponent=0, VComponent=division_11, WComponent=0)
pt_22 = PointOriented(BasePlane=anfeb_3, UComponent=0, VComponent=0, WComponent=0)
ln_7 = Line(StartPoint=pt_20, EndPoint=pt_21)
midpt_5 = CurveMiddle(Curve=ln_7)
srf4pt_7 = _4PointSurface(CornerA=pt_19, CornerB=pt_20, CornerC=pt_21, CornerD=pt_22)
and_7 = GateAnd(A=normalkraft_n_kn, B=werte)
filter_18 = StreamFilter(Gate=and_7, Stream1=eval_9)
filter_19 = StreamFilter(Gate=normalkraft_n_kn, Stream1=srf4pt_7)
smaller_2 = SmallerThan(FirstNumber=division_11, SecondNumber=0)  # -> SmallerThan, OrEqualTo
dispatch_5 = Dispatch(List=filter_19, DispatchPattern=smaller_2.SmallerThan)  # -> ListA, ListB
preview_10 = CustomPreview(Geometry=dispatch_5.ListA, Material=farbe_4)
preview_11 = CustomPreview(Geometry=dispatch_5.ListB, Material=farbe_6)
tag_8 = TextTag(Location=midpt_5, Text=filter_18, Colour=farbe_3)

# ---- group: QUERKRAFT Vy
flatten_29 = FlattenTree(Tree=beamoutput_träger_cd_2.Vy, Path="{0}")
division_12 = Division(A=flatten_29, B=reduktion_v)
eval_10 = Evaluate(E="If(round(x,y)=0,\"\",If(round(x,y)>0,Format(\"+{0}\",round(x,y)),round(x,y)))", x=flatten_29, y=nachkommastellen)
pt_23 = PointOriented(BasePlane=endeb_3, UComponent=0, VComponent=0, WComponent=0)
pt_24 = PointOriented(BasePlane=endeb_3, UComponent=division_12, VComponent=0, WComponent=0)
pt_25 = PointOriented(BasePlane=anfeb_3, UComponent=division_12, VComponent=0, WComponent=0)
pt_26 = PointOriented(BasePlane=anfeb_3, UComponent=0, VComponent=0, WComponent=0)
ln_8 = Line(StartPoint=pt_24, EndPoint=pt_25)
midpt_6 = CurveMiddle(Curve=ln_8)
srf4pt_8 = _4PointSurface(CornerA=pt_23, CornerB=pt_24, CornerC=pt_25, CornerD=pt_26)
and_8 = GateAnd(A=querkraft_vy_kn, B=werte)
filter_20 = StreamFilter(Gate=and_8, Stream1=eval_10)
filter_21 = StreamFilter(Gate=querkraft_vy_kn, Stream1=srf4pt_8)
preview_12 = CustomPreview(Geometry=filter_21, Material=farbe_7)
tag_9 = TextTag(Location=midpt_6, Text=filter_20, Colour=farbe_3)

# ---- group: MOMENT My
flatten_30 = FlattenTree(Tree=beamoutput_träger_cd_2.My1, Path="{0}")
flatten_31 = FlattenTree(Tree=beamoutput_träger_cd_2.My0, Path="{0}")
neg_4 = Negative(Value=flatten_31)
division_13 = Division(A=flatten_30, B=reduktion_m)
division_14 = Division(A=neg_4, B=reduktion_m)
pt_27 = PointOriented(BasePlane=endeb_3, UComponent=0, VComponent=0, WComponent=0)
pt_28 = PointOriented(BasePlane=endeb_3, UComponent=0, VComponent=division_13, WComponent=0)
pt_29 = PointOriented(BasePlane=anfeb_3, UComponent=0, VComponent=division_14, WComponent=0)
pt_30 = PointOriented(BasePlane=anfeb_3, UComponent=0, VComponent=0, WComponent=0)
ln_9 = Line(StartPoint=pt_27, EndPoint=pt_30)
ln_10 = Line(StartPoint=pt_28, EndPoint=pt_29)
ccx_2 = CurveCurve(CurveA=ln_9, CurveB=ln_10)  # -> Points, ParamsA, ParamsB
item_6 = ListItem(List=flatten_30, Index=-1, Wrap=True)
item_7 = ListItem(List=pt_28, Index=-1, Wrap=True)
flatten_32 = FlattenTree(Tree=ccx_2.Points, Path="{0}")
neg_5 = Negative(Value=item_6)
srf4pt_9 = _4PointSurface(CornerA=pt_27, CornerB=pt_28, CornerC=flatten_32)
srf4pt_10 = _4PointSurface(CornerA=pt_30, CornerB=flatten_32, CornerC=pt_29)
srf4pt_11 = _4PointSurface(CornerA=pt_27, CornerB=pt_28, CornerC=pt_29, CornerD=pt_30)
multiplication_11 = Multiplication(A=division_13, B=division_14)
flatten_33 = FlattenTree(Tree=[flatten_31, neg_5], Path="{0}")
flatten_34 = FlattenTree(Tree=[pt_29, item_7], Path="{0}")
larger_2 = LargerThan(FirstNumber=multiplication_11, SecondNumber=0)  # -> LargerThan, OrEqualTo
not_3 = GateNot(A=larger_2.LargerThan)
and_9 = GateAnd(A=moment_my_knm, B=werte)
eval_11 = Evaluate(E="If(round(x,y)=0,\"\",If(round(x,y)>0,Format(\"+{0}\",round(x,y)),round(x,y)))", x=flatten_33, y=nachkommastellen)
dispatch_6 = Dispatch(List=srf4pt_9, DispatchPattern=not_3)  # -> ListA, ListB
dispatch_7 = Dispatch(List=srf4pt_10, DispatchPattern=not_3)  # -> ListA, ListB
dispatch_8 = Dispatch(List=srf4pt_11, DispatchPattern=larger_2.LargerThan)  # -> ListA, ListB
filter_22 = StreamFilter(Gate=and_9, Stream1=eval_11)
srf_2 = Surface([dispatch_6.ListA, dispatch_7.ListA, dispatch_8.ListA])
filter_23 = StreamFilter(Gate=moment_my_knm, Stream1=srf_2)
preview_13 = CustomPreview(Geometry=filter_23, Material=farbe_5)
tag_10 = TextTag(Location=flatten_34, Text=filter_22, Colour=farbe_3)

# ---- group: QUERKRAFT Vz
flatten_35 = FlattenTree(Tree=beamoutput_träger_cd_2.Vz, Path="{0}")
division_15 = Division(A=flatten_35, B=reduktion_v)
eval_12 = Evaluate(E="If(round(x,y)=0,\"\",If(round(x,y)>0,Format(\"+{0}\",round(x,y)),round(x,y)))", x=flatten_35, y=nachkommastellen)
pt_31 = PointOriented(BasePlane=endeb_3, UComponent=0, VComponent=0, WComponent=0)
pt_32 = PointOriented(BasePlane=endeb_3, UComponent=0, VComponent=division_15, WComponent=0)
pt_33 = PointOriented(BasePlane=anfeb_3, UComponent=0, VComponent=division_15, WComponent=0)
pt_34 = PointOriented(BasePlane=anfeb_3, UComponent=0, VComponent=0, WComponent=0)
ln_11 = Line(StartPoint=pt_32, EndPoint=pt_33)
midpt_7 = CurveMiddle(Curve=ln_11)
srf4pt_12 = _4PointSurface(CornerA=pt_31, CornerB=pt_32, CornerC=pt_33, CornerD=pt_34)
and_10 = GateAnd(A=querkraft_vz_kn, B=werte)
filter_24 = StreamFilter(Gate=and_10, Stream1=eval_12)
filter_25 = StreamFilter(Gate=querkraft_vz_kn, Stream1=srf4pt_12)
preview_14 = CustomPreview(Geometry=filter_25, Material=farbe_7)
tag_11 = TextTag(Location=midpt_7, Text=filter_24, Colour=farbe_3)

# ---- group: SPANNUNGSRATIO
ln_12 = Line(StartPoint=anfeb_3, EndPoint=endeb_3)
normal_spannung_2 = Python3Script(
    N=beamoutput_träger_cd_2.N,
    My0=beamoutput_träger_cd_2.My0,
    Mz0=beamoutput_träger_cd_2.Mz0,
    My1=beamoutput_träger_cd_2.My1,
    Mz1=beamoutput_träger_cd_2.Mz1,
    A=fläche_a_mm2_5,
    Wp=widerstandsmoment_wp_mm3_5,
    Ws=widerstandsmoment_ws_mm3_5)  # -> out, S0, S1; same code as normal_spannung
filter_26 = StreamFilter(Gate=zum_maximum, Stream0=panel_6)
division_16 = Division(A=normal_spannung_2.S0, B=filter_26)
division_17 = Division(A=normal_spannung_2.S1, B=filter_26)
multiplication_12 = Multiplication(A=division_17, B=7)
multiplication_13 = Multiplication(A=division_16, B=7)
round_3 = Round(Number=multiplication_12)  # -> Nearest, Floor, Ceiling
round_4 = Round(Number=multiplication_13)  # -> Nearest, Floor, Ceiling
max_3 = Maximum(A=division_16, B=division_17)
min_3 = Minimum(A=round_3.Floor, B=8)
min_4 = Minimum(A=round_4.Floor, B=8)
max_4 = Maximum(A=min_4, B=min_3)
item_8 = ListItem(List=flatten, Index=max_4, Wrap=True)
eval_13 = Evaluate(E="If(round(100.0*x,Y)<z,\"\",Format(\"{0}%\",round(100.0*x,Y)))", x=max_3, y=nachkommastellen, z=ratio_über_zeigen)
pt_35 = PointOriented(BasePlane=anfeb_3, UComponent=0, VComponent="0.1", WComponent=0)
midpt_8 = CurveMiddle(Curve=ln_12)
vec2pt_2 = Vector2Pt(PointA=anfeb_3, PointB=pt_35, Unitize=False)  # -> Vector, Length
filter_27 = StreamFilter(Gate=spannungsratio, Stream1=ln_12)
addition_4 = Addition(A=vec2pt_2.Vector, B=midpt_8)
filter_28 = StreamFilter(Gate=spannungsratio, Stream1=eval_13)
preview_15 = CustomPreview(Geometry=filter_27, Material=item_8)
tag_12 = TextTag(Location=addition_4, Text=filter_28, Colour=item_8)

# ----
beamoutput_träger_cd_3 = BeamOutput(BeamData=stütze_bd_in_a_und_diagonal_in_b.ListA)  # -> P0, P1, N, Vy, Vz, Mt, My0, Mz0, My1, Mz1

# ---- group: VERFORMUNG
deplane_9 = DeconstructPlane(Plane=anfeb)  # -> Origin, XAxis, YAxis, ZAxis
deplane_10 = DeconstructPlane(Plane=endeb)  # -> Origin, XAxis, YAxis, ZAxis
deplane_11 = DeconstructPlane(Plane=beamoutput_träger_cd_3.P0)  # -> Origin, XAxis, YAxis, ZAxis
deplane_12 = DeconstructPlane(Plane=beamoutput_träger_cd_3.P1)  # -> Origin, XAxis, YAxis, ZAxis
subtraction_8 = Subtraction(A=deplane_11.Origin, B=deplane_9.Origin)
subtraction_9 = Subtraction(A=deplane_12.Origin, B=deplane_10.Origin)
letzte_5 = ListItem(List=deplane_10.Origin, Index=-1, Wrap=True)
letzte_6 = ListItem(List=subtraction_9, Index=-1, Wrap=True)
flatten_36 = FlattenTree(Tree=[deplane_9.Origin, letzte_5], Path="{0}")
flatten_37 = FlattenTree(Tree=[subtraction_8, letzte_6], Path="{0}")
m_zu_mm_3 = Multiplication(A=flatten_37, B=1000)
multiplication_14 = Multiplication(A=flatten_37, B=faktor)
pdecon_3 = Deconstruct(Point=m_zu_mm_3)  # -> XComponent, YComponent, ZComponent
addition_5 = Addition(A=flatten_36, B=multiplication_14)
eval_14 = Evaluate(
    E="Format(\"({0},{1},{2})\",Round(x,n),Round(y,n),Round(z,n))",
    x=pdecon_3.XComponent,
    y=pdecon_3.YComponent,
    z=pdecon_3.ZComponent,
    n=nachkommastellen)
intcrv_3 = Interpolate(Vertices=addition_5, Degree=4, Periodic=False, KnotStyle=1)  # -> Curve, Length, Domain
and_11 = GateAnd(A=wireframe_verformung, B=werte_der_bewegungen_mm)
filter_29 = StreamFilter(Gate=and_11, Stream1=eval_14)
filter_30 = StreamFilter(Gate=wireframe_verformung, Stream1=intcrv_3.Curve)
preview_16 = CustomPreview(Geometry=filter_30, Material=farbe)
tag_13 = TextTag(Location=addition_5, Text=filter_29, Colour=farbe_2)

# ---- group: NORMALKRAFT N
flatten_38 = FlattenTree(Tree=beamoutput_träger_cd_3.N, Path="{0}")
division_18 = Division(A=flatten_38, B=reduktion_n)
eval_15 = Evaluate(E="If(round(x,y)=0,\"\",If(round(x,y)>0,Format(\"+{0}\",round(x,y)),round(x,y)))", x=flatten_38, y=nachkommastellen)
pt_36 = PointOriented(BasePlane=endeb, UComponent=0, VComponent=0, WComponent=0)
pt_37 = PointOriented(BasePlane=endeb, UComponent=0, VComponent=division_18, WComponent=0)
pt_38 = PointOriented(BasePlane=anfeb, UComponent=0, VComponent=division_18, WComponent=0)
pt_39 = PointOriented(BasePlane=anfeb, UComponent=0, VComponent=0, WComponent=0)
ln_13 = Line(StartPoint=pt_37, EndPoint=pt_38)
midpt_9 = CurveMiddle(Curve=ln_13)
srf4pt_13 = _4PointSurface(CornerA=pt_36, CornerB=pt_37, CornerC=pt_38, CornerD=pt_39)
and_12 = GateAnd(A=normalkraft_n_kn, B=werte)
filter_31 = StreamFilter(Gate=and_12, Stream1=eval_15)
filter_32 = StreamFilter(Gate=normalkraft_n_kn, Stream1=srf4pt_13)
smaller_3 = SmallerThan(FirstNumber=division_18, SecondNumber=0)  # -> SmallerThan, OrEqualTo
dispatch_9 = Dispatch(List=filter_32, DispatchPattern=smaller_3.SmallerThan)  # -> ListA, ListB
preview_17 = CustomPreview(Geometry=dispatch_9.ListA, Material=farbe_4)
preview_18 = CustomPreview(Geometry=dispatch_9.ListB, Material=farbe_6)
tag_14 = TextTag(Location=midpt_9, Text=filter_31, Colour=farbe_3)

# ---- group: QUERKRAFT Vy
flatten_39 = FlattenTree(Tree=beamoutput_träger_cd_3.Vy, Path="{0}")
division_19 = Division(A=flatten_39, B=reduktion_v)
eval_16 = Evaluate(E="If(round(x,y)=0,\"\",If(round(x,y)>0,Format(\"+{0}\",round(x,y)),round(x,y)))", x=flatten_39, y=nachkommastellen)
pt_40 = PointOriented(BasePlane=endeb, UComponent=0, VComponent=0, WComponent=0)
pt_41 = PointOriented(BasePlane=endeb, UComponent=division_19, VComponent=0, WComponent=0)
pt_42 = PointOriented(BasePlane=anfeb, UComponent=division_19, VComponent=0, WComponent=0)
pt_43 = PointOriented(BasePlane=anfeb, UComponent=0, VComponent=0, WComponent=0)
ln_14 = Line(StartPoint=pt_41, EndPoint=pt_42)
midpt_10 = CurveMiddle(Curve=ln_14)
srf4pt_14 = _4PointSurface(CornerA=pt_40, CornerB=pt_41, CornerC=pt_42, CornerD=pt_43)
and_13 = GateAnd(A=querkraft_vy_kn, B=werte)
filter_33 = StreamFilter(Gate=and_13, Stream1=eval_16)
filter_34 = StreamFilter(Gate=querkraft_vy_kn, Stream1=srf4pt_14)
preview_19 = CustomPreview(Geometry=filter_34, Material=farbe_7)
tag_15 = TextTag(Location=midpt_10, Text=filter_33, Colour=farbe_3)

# ---- group: MOMENT My
flatten_40 = FlattenTree(Tree=beamoutput_träger_cd_3.My1, Path="{0}")
flatten_41 = FlattenTree(Tree=beamoutput_träger_cd_3.My0, Path="{0}")
neg_6 = Negative(Value=flatten_41)
division_20 = Division(A=flatten_40, B=reduktion_m)
division_21 = Division(A=neg_6, B=reduktion_m)
pt_44 = PointOriented(BasePlane=endeb, UComponent=0, VComponent=0, WComponent=0)
pt_45 = PointOriented(BasePlane=endeb, UComponent=0, VComponent=division_20, WComponent=0)
pt_46 = PointOriented(BasePlane=anfeb, UComponent=0, VComponent=division_21, WComponent=0)
pt_47 = PointOriented(BasePlane=anfeb, UComponent=0, VComponent=0, WComponent=0)
ln_15 = Line(StartPoint=pt_44, EndPoint=pt_47)
ln_16 = Line(StartPoint=pt_45, EndPoint=pt_46)
ccx_3 = CurveCurve(CurveA=ln_15, CurveB=ln_16)  # -> Points, ParamsA, ParamsB
item_9 = ListItem(List=flatten_40, Index=-1, Wrap=True)
item_10 = ListItem(List=pt_45, Index=-1, Wrap=True)
flatten_42 = FlattenTree(Tree=ccx_3.Points, Path="{0}")
neg_7 = Negative(Value=item_9)
srf4pt_15 = _4PointSurface(CornerA=pt_44, CornerB=pt_45, CornerC=flatten_42)
srf4pt_16 = _4PointSurface(CornerA=pt_47, CornerB=flatten_42, CornerC=pt_46)
srf4pt_17 = _4PointSurface(CornerA=pt_44, CornerB=pt_45, CornerC=pt_46, CornerD=pt_47)
multiplication_15 = Multiplication(A=division_20, B=division_21)
flatten_43 = FlattenTree(Tree=[flatten_41, neg_7], Path="{0}")
flatten_44 = FlattenTree(Tree=[pt_46, item_10], Path="{0}")
larger_3 = LargerThan(FirstNumber=multiplication_15, SecondNumber=0)  # -> LargerThan, OrEqualTo
not_4 = GateNot(A=larger_3.LargerThan)
and_14 = GateAnd(A=moment_my_knm, B=werte)
eval_17 = Evaluate(E="If(round(x,y)=0,\"\",If(round(x,y)>0,Format(\"+{0}\",round(x,y)),round(x,y)))", x=flatten_43, y=nachkommastellen)
dispatch_10 = Dispatch(List=srf4pt_15, DispatchPattern=not_4)  # -> ListA, ListB
dispatch_11 = Dispatch(List=srf4pt_16, DispatchPattern=not_4)  # -> ListA, ListB
dispatch_12 = Dispatch(List=srf4pt_17, DispatchPattern=larger_3.LargerThan)  # -> ListA, ListB
filter_35 = StreamFilter(Gate=and_14, Stream1=eval_17)
srf_3 = Surface([dispatch_10.ListA, dispatch_11.ListA, dispatch_12.ListA])
filter_36 = StreamFilter(Gate=moment_my_knm, Stream1=srf_3)
preview_20 = CustomPreview(Geometry=filter_36, Material=farbe_5)
tag_16 = TextTag(Location=flatten_44, Text=filter_35, Colour=farbe_3)

# ---- group: QUERKRAFT Vz
flatten_45 = FlattenTree(Tree=beamoutput_träger_cd_3.Vz, Path="{0}")
division_22 = Division(A=flatten_45, B=reduktion_v)
eval_18 = Evaluate(E="If(round(x,y)=0,\"\",If(round(x,y)>0,Format(\"+{0}\",round(x,y)),round(x,y)))", x=flatten_45, y=nachkommastellen)
pt_48 = PointOriented(BasePlane=endeb, UComponent=0, VComponent=0, WComponent=0)
pt_49 = PointOriented(BasePlane=endeb, UComponent=0, VComponent=division_22, WComponent=0)
pt_50 = PointOriented(BasePlane=anfeb, UComponent=0, VComponent=division_22, WComponent=0)
pt_51 = PointOriented(BasePlane=anfeb, UComponent=0, VComponent=0, WComponent=0)
ln_17 = Line(StartPoint=pt_49, EndPoint=pt_50)
midpt_11 = CurveMiddle(Curve=ln_17)
srf4pt_18 = _4PointSurface(CornerA=pt_48, CornerB=pt_49, CornerC=pt_50, CornerD=pt_51)
and_15 = GateAnd(A=querkraft_vz_kn, B=werte)
filter_37 = StreamFilter(Gate=and_15, Stream1=eval_18)
filter_38 = StreamFilter(Gate=querkraft_vz_kn, Stream1=srf4pt_18)
preview_21 = CustomPreview(Geometry=filter_38, Material=farbe_7)
tag_17 = TextTag(Location=midpt_11, Text=filter_37, Colour=farbe_3)

# ---- group: SPANNUNGSRATIO
ln_18 = Line(StartPoint=anfeb, EndPoint=endeb)
normal_spannung_3 = Python3Script(
    N=beamoutput_träger_cd_3.N,
    My0=beamoutput_träger_cd_3.My0,
    Mz0=beamoutput_träger_cd_3.Mz0,
    My1=beamoutput_träger_cd_3.My1,
    Mz1=beamoutput_träger_cd_3.Mz1,
    A=fläche_a_mm2_6,
    Wp=widerstandsmoment_wp_mm3_6,
    Ws=widerstandsmoment_ws_mm3_6)  # -> out, S0, S1; same code as normal_spannung
filter_39 = StreamFilter(Gate=zum_maximum, Stream0=panel_6)
division_23 = Division(A=normal_spannung_3.S0, B=filter_39)
division_24 = Division(A=normal_spannung_3.S1, B=filter_39)
multiplication_16 = Multiplication(A=division_24, B=7)
multiplication_17 = Multiplication(A=division_23, B=7)
round_5 = Round(Number=multiplication_16)  # -> Nearest, Floor, Ceiling
round_6 = Round(Number=multiplication_17)  # -> Nearest, Floor, Ceiling
max_5 = Maximum(A=division_23, B=division_24)
min_5 = Minimum(A=round_5.Floor, B=8)
min_6 = Minimum(A=round_6.Floor, B=8)
max_6 = Maximum(A=min_6, B=min_5)
item_11 = ListItem(List=flatten, Index=max_6, Wrap=True)
eval_19 = Evaluate(E="If(round(100.0*x,Y)<z,\"\",Format(\"{0}%\",round(100.0*x,Y)))", x=max_5, y=nachkommastellen, z=ratio_über_zeigen)
pt_52 = PointOriented(BasePlane=anfeb, UComponent=0, VComponent="0.1", WComponent=0)
midpt_12 = CurveMiddle(Curve=ln_18)
vec2pt_3 = Vector2Pt(PointA=anfeb, PointB=pt_52, Unitize=False)  # -> Vector, Length
filter_40 = StreamFilter(Gate=spannungsratio, Stream1=ln_18)
addition_6 = Addition(A=vec2pt_3.Vector, B=midpt_12)
filter_41 = StreamFilter(Gate=spannungsratio, Stream1=eval_19)
preview_22 = CustomPreview(Geometry=filter_40, Material=item_11)
tag_18 = TextTag(Location=addition_6, Text=filter_41, Colour=item_11)

# ----
# Das ist neu programmiert (im Vergleich zu Übung 1), um es leichter zu benutzen auf anderen Beispielen.
# 
# Alles in dieser Gruppe kann kopiert werden, um die Ergebnise einer anderen Stab (BEAM 3DOF - Zug oder Druckstab) darzustellen.
# 
# Es müssen nur die Eingabedaten verknüpft werden:
# 1. Anfangs- und EndEbenen
# 2. Ergebnis aus den Solver
# 
# Die Querschnitts eigenschaften sind nicht nötig weil die Ergebnisse vom Solver (K2Engineering) schon die Spannung inhalten.
# 
# Alles andere bleibt intern un ermöglicht die Darstellung alle Ergenisse einer BEAM 3DOF: Verformung, Normalkraft und Spannungsratio.
baroutput_diagonal_ad = BarOutput(BarData=stütze_bd_in_a_und_diagonal_in_b.ListB)  # -> Line, AxialForce, AxialStress
flatten_46 = FlattenTree(Tree=baroutput_diagonal_ad.AxialForce, Path="{0}")
division_25 = Division(A=flatten_46, B=reduktion_n)
eval_20 = Evaluate(E="If(round(x,y)=0,\"\",If(round(x,y)>0,Format(\"+{0}\",round(x,y)),round(x,y)))", x=flatten_46, y=nachkommastellen)
pt_53 = PointOriented(BasePlane=endebdiagonal_2, UComponent=0, VComponent=0, WComponent=0)
pt_54 = PointOriented(BasePlane=endebdiagonal_2, UComponent=0, VComponent=division_25, WComponent=0)
pt_55 = PointOriented(BasePlane=anfebdiagonal_2, UComponent=0, VComponent=division_25, WComponent=0)
pt_56 = PointOriented(BasePlane=anfebdiagonal_2, UComponent=0, VComponent=0, WComponent=0)
ln_19 = Line(StartPoint=pt_54, EndPoint=pt_55)
midpt_13 = CurveMiddle(Curve=ln_19)
srf4pt_19 = _4PointSurface(CornerA=pt_53, CornerB=pt_54, CornerC=pt_55, CornerD=pt_56)
and_16 = GateAnd(A=normalkraft_n_kn, B=werte)
filter_42 = StreamFilter(Gate=and_16, Stream1=eval_20)
filter_43 = StreamFilter(Gate=normalkraft_n_kn, Stream1=srf4pt_19)
smaller_4 = SmallerThan(FirstNumber=division_25, SecondNumber=0)  # -> SmallerThan, OrEqualTo
dispatch_13 = Dispatch(List=filter_43, DispatchPattern=smaller_4.SmallerThan)  # -> ListA, ListB
preview_23 = CustomPreview(Geometry=dispatch_13.ListA, Material=farbe_4)
preview_24 = CustomPreview(Geometry=dispatch_13.ListB, Material=farbe_6)
tag_19 = TextTag(Location=midpt_13, Text=filter_42, Colour=farbe_3)

# ---- group: MOMENT Mz
flatten_47 = FlattenTree(Tree=beamoutput_träger_cd.Mz1, Path="{0}")
flatten_48 = FlattenTree(Tree=beamoutput_träger_cd.Mz0, Path="{0}")
division_26 = Division(A=flatten_48, B=reduktion_m)
pt_57 = PointOriented(BasePlane=endeb_2, UComponent=0, VComponent=0, WComponent=0)
pt_58 = PointOriented(BasePlane=anfeb_2, UComponent=division_26, VComponent=0, WComponent=0)
pt_59 = PointOriented(BasePlane=anfeb_2, UComponent=0, VComponent=0, WComponent=0)
ln_20 = Line(StartPoint=pt_57, EndPoint=pt_59)
item_12 = ListItem(List=flatten_47, Index=-1, Wrap=True)
neg_8 = Negative(Value=item_12)
flatten_49 = FlattenTree(Tree=[flatten_48, neg_8], Path="{0}")
and_17 = GateAnd(A=moment_mz_knm, B=werte)
eval_21 = Evaluate(E="If(round(x,y)=0,\"\",If(round(x,y)>0,Format(\"+{0}\",round(x,y)),round(x,y)))", x=flatten_49, y=nachkommastellen)
filter_44 = StreamFilter(Gate=and_17, Stream1=eval_21)

# ----
neg_9 = Negative(Value=flatten_47)

# ---- group: MOMENT Mz (continued)
division_27 = Division(A=neg_9, B=reduktion_m)
pt_60 = PointOriented(BasePlane=endeb_2, UComponent=division_27, VComponent=0, WComponent=0)
ln_21 = Line(StartPoint=pt_60, EndPoint=pt_58)
ccx_4 = CurveCurve(CurveA=ln_20, CurveB=ln_21)  # -> Points, ParamsA, ParamsB
item_13 = ListItem(List=pt_60, Index=-1, Wrap=True)
flatten_50 = FlattenTree(Tree=ccx_4.Points, Path="{0}")
srf4pt_20 = _4PointSurface(CornerA=pt_57, CornerB=pt_60, CornerC=flatten_50)
srf4pt_21 = _4PointSurface(CornerA=pt_59, CornerB=flatten_50, CornerC=pt_58)
srf4pt_22 = _4PointSurface(CornerA=pt_57, CornerB=pt_60, CornerC=pt_58, CornerD=pt_59)
multiplication_18 = Multiplication(A=division_27, B=division_26)
flatten_51 = FlattenTree(Tree=[pt_58, item_13], Path="{0}")
larger_4 = LargerThan(FirstNumber=multiplication_18, SecondNumber=0)  # -> LargerThan, OrEqualTo
not_5 = GateNot(A=larger_4.LargerThan)
dispatch_14 = Dispatch(List=srf4pt_20, DispatchPattern=not_5)  # -> ListA, ListB
dispatch_15 = Dispatch(List=srf4pt_21, DispatchPattern=not_5)  # -> ListA, ListB
dispatch_16 = Dispatch(List=srf4pt_22, DispatchPattern=larger_4.LargerThan)  # -> ListA, ListB
srf_4 = Surface([dispatch_14.ListA, dispatch_15.ListA, dispatch_16.ListA])
filter_45 = StreamFilter(Gate=moment_mz_knm, Stream1=srf_4)
preview_25 = CustomPreview(Geometry=filter_45, Material=farbe_5)
tag_20 = TextTag(Location=flatten_51, Text=filter_44, Colour=farbe_3)

flatten_52 = FlattenTree(Tree=beamoutput_träger_cd_2.Mz1, Path="{0}")
flatten_53 = FlattenTree(Tree=beamoutput_träger_cd_2.Mz0, Path="{0}")
division_28 = Division(A=flatten_53, B=reduktion_m)
pt_61 = PointOriented(BasePlane=endeb_3, UComponent=0, VComponent=0, WComponent=0)
pt_62 = PointOriented(BasePlane=anfeb_3, UComponent=division_28, VComponent=0, WComponent=0)
pt_63 = PointOriented(BasePlane=anfeb_3, UComponent=0, VComponent=0, WComponent=0)
ln_22 = Line(StartPoint=pt_61, EndPoint=pt_63)
item_14 = ListItem(List=flatten_52, Index=-1, Wrap=True)
neg_10 = Negative(Value=item_14)
flatten_54 = FlattenTree(Tree=[flatten_53, neg_10], Path="{0}")
and_18 = GateAnd(A=moment_mz_knm, B=werte)
eval_22 = Evaluate(E="If(round(x,y)=0,\"\",If(round(x,y)>0,Format(\"+{0}\",round(x,y)),round(x,y)))", x=flatten_54, y=nachkommastellen)
filter_46 = StreamFilter(Gate=and_18, Stream1=eval_22)

# ----
neg_11 = Negative(Value=flatten_52)

# ---- group: MOMENT Mz (continued)
division_29 = Division(A=neg_11, B=reduktion_m)
pt_64 = PointOriented(BasePlane=endeb_3, UComponent=division_29, VComponent=0, WComponent=0)
ln_23 = Line(StartPoint=pt_64, EndPoint=pt_62)
ccx_5 = CurveCurve(CurveA=ln_22, CurveB=ln_23)  # -> Points, ParamsA, ParamsB
item_15 = ListItem(List=pt_64, Index=-1, Wrap=True)
flatten_55 = FlattenTree(Tree=ccx_5.Points, Path="{0}")
srf4pt_23 = _4PointSurface(CornerA=pt_61, CornerB=pt_64, CornerC=flatten_55)
srf4pt_24 = _4PointSurface(CornerA=pt_63, CornerB=flatten_55, CornerC=pt_62)
srf4pt_25 = _4PointSurface(CornerA=pt_61, CornerB=pt_64, CornerC=pt_62, CornerD=pt_63)
multiplication_19 = Multiplication(A=division_29, B=division_28)
flatten_56 = FlattenTree(Tree=[pt_62, item_15], Path="{0}")
larger_5 = LargerThan(FirstNumber=multiplication_19, SecondNumber=0)  # -> LargerThan, OrEqualTo
not_6 = GateNot(A=larger_5.LargerThan)
dispatch_17 = Dispatch(List=srf4pt_23, DispatchPattern=not_6)  # -> ListA, ListB
dispatch_18 = Dispatch(List=srf4pt_24, DispatchPattern=not_6)  # -> ListA, ListB
dispatch_19 = Dispatch(List=srf4pt_25, DispatchPattern=larger_5.LargerThan)  # -> ListA, ListB
srf_5 = Surface([dispatch_17.ListA, dispatch_18.ListA, dispatch_19.ListA])
filter_47 = StreamFilter(Gate=moment_mz_knm, Stream1=srf_5)
preview_26 = CustomPreview(Geometry=filter_47, Material=farbe_5)
tag_21 = TextTag(Location=flatten_56, Text=filter_46, Colour=farbe_3)

# ---- group: Verformung
deplane_13 = DeconstructPlane(Plane=anfebdiagonal_2)  # -> Origin, XAxis, YAxis, ZAxis
deplane_14 = DeconstructPlane(Plane=endebdiagonal_2)  # -> Origin, XAxis, YAxis, ZAxis
end_2 = EndPoints(Curve=baroutput_diagonal_ad.Line)  # -> Start, End
subtraction_10 = Subtraction(A=end_2.Start, B=deplane_13.Origin)
subtraction_11 = Subtraction(A=end_2.End, B=deplane_14.Origin)
letzte_7 = ListItem(List=deplane_14.Origin, Index=-1, Wrap=True)
letzte_8 = ListItem(List=subtraction_11, Index=-1, Wrap=True)
flatten_57 = FlattenTree(Tree=[deplane_13.Origin, letzte_7], Path="{0}")
flatten_58 = FlattenTree(Tree=[subtraction_10, letzte_8], Path="{0}")
m_zu_mm_4 = Multiplication(A=flatten_58, B=1000)
multiplication_20 = Multiplication(A=flatten_58, B=faktor)
pdecon_4 = Deconstruct(Point=m_zu_mm_4)  # -> XComponent, YComponent, ZComponent
addition_7 = Addition(A=flatten_57, B=multiplication_20)
eval_23 = Evaluate(
    E="Format(\"({0},{1},{2})\",Round(x,n),Round(y,n),Round(z,n))",
    x=pdecon_4.XComponent,
    y=pdecon_4.YComponent,
    z=pdecon_4.ZComponent,
    n=nachkommastellen)
and_19 = GateAnd(A=wireframe_verformung, B=werte_der_bewegungen_mm)
filter_48 = StreamFilter(Gate=and_19, Stream1=eval_23)
tag_22 = TextTag(Location=addition_7, Text=filter_48, Colour=farbe_2)

# ----
pline_4 = PolyLine(Vertices=addition_7, Closed=False)

# ---- group: Verformung (continued)
filter_49 = StreamFilter(Gate=wireframe_verformung, Stream1=pline_4)
preview_27 = CustomPreview(Geometry=filter_49, Material=farbe)

# ---- group: SPANNUNGSRATIO
ln_24 = Line(StartPoint=end_2.Start, EndPoint=end_2.End)
filter_50 = StreamFilter(Gate=zum_maximum, Stream0=panel_6)
division_30 = Division(A=baroutput_diagonal_ad.AxialStress, B=filter_50)
division_31 = Division(A=baroutput_diagonal_ad.AxialStress, B=filter_50)
multiplication_21 = Multiplication(A=division_31, B=7)
multiplication_22 = Multiplication(A=division_30, B=7)
round_7 = Round(Number=multiplication_21)  # -> Nearest, Floor, Ceiling
round_8 = Round(Number=multiplication_22)  # -> Nearest, Floor, Ceiling
max_7 = Maximum(A=division_30, B=division_31)
min_7 = Minimum(A=round_7.Floor, B=8)
min_8 = Minimum(A=round_8.Floor, B=8)
max_8 = Maximum(A=min_8, B=min_7)
item_16 = ListItem(List=flatten, Index=max_8, Wrap=True)
eval_24 = Evaluate(E="If(round(100.0*x,Y)<z,\"\",Format(\"{0}%\",round(100.0*x,Y)))", x=max_7, y=nachkommastellen, z=ratio_über_zeigen)
pt_65 = PointOriented(BasePlane=anfebdiagonal_2, UComponent=0, VComponent="0.1", WComponent=0)
midpt_14 = CurveMiddle(Curve=ln_24)
vec2pt_4 = Vector2Pt(PointA=anfebdiagonal_2, PointB=pt_65, Unitize=False)  # -> Vector, Length
filter_51 = StreamFilter(Gate=spannungsratio, Stream1=ln_24)
addition_8 = Addition(A=vec2pt_4.Vector, B=midpt_14)
filter_52 = StreamFilter(Gate=spannungsratio, Stream1=eval_24)
preview_28 = CustomPreview(Geometry=filter_51, Material=item_16)
tag_23 = TextTag(Location=addition_8, Text=filter_52, Colour=item_16)

# ---- group: MOMENT Mz
flatten_59 = FlattenTree(Tree=beamoutput_träger_cd_3.Mz1, Path="{0}")
flatten_60 = FlattenTree(Tree=beamoutput_träger_cd_3.Mz0, Path="{0}")
division_32 = Division(A=flatten_60, B=reduktion_m)
pt_66 = PointOriented(BasePlane=endeb, UComponent=0, VComponent=0, WComponent=0)
pt_67 = PointOriented(BasePlane=anfeb, UComponent=division_32, VComponent=0, WComponent=0)
pt_68 = PointOriented(BasePlane=anfeb, UComponent=0, VComponent=0, WComponent=0)
ln_25 = Line(StartPoint=pt_66, EndPoint=pt_68)
item_17 = ListItem(List=flatten_59, Index=-1, Wrap=True)
neg_12 = Negative(Value=item_17)
flatten_61 = FlattenTree(Tree=[flatten_60, neg_12], Path="{0}")
and_20 = GateAnd(A=moment_mz_knm, B=werte)
eval_25 = Evaluate(E="If(round(x,y)=0,\"\",If(round(x,y)>0,Format(\"+{0}\",round(x,y)),round(x,y)))", x=flatten_61, y=nachkommastellen)
filter_53 = StreamFilter(Gate=and_20, Stream1=eval_25)

# ----
neg_13 = Negative(Value=flatten_59)

# ---- group: MOMENT Mz (continued)
division_33 = Division(A=neg_13, B=reduktion_m)
pt_69 = PointOriented(BasePlane=endeb, UComponent=division_33, VComponent=0, WComponent=0)
ln_26 = Line(StartPoint=pt_69, EndPoint=pt_67)
ccx_6 = CurveCurve(CurveA=ln_25, CurveB=ln_26)  # -> Points, ParamsA, ParamsB
item_18 = ListItem(List=pt_69, Index=-1, Wrap=True)
flatten_62 = FlattenTree(Tree=ccx_6.Points, Path="{0}")
srf4pt_26 = _4PointSurface(CornerA=pt_66, CornerB=pt_69, CornerC=flatten_62)
srf4pt_27 = _4PointSurface(CornerA=pt_68, CornerB=flatten_62, CornerC=pt_67)
srf4pt_28 = _4PointSurface(CornerA=pt_66, CornerB=pt_69, CornerC=pt_67, CornerD=pt_68)
multiplication_23 = Multiplication(A=division_33, B=division_32)
flatten_63 = FlattenTree(Tree=[pt_67, item_18], Path="{0}")
larger_6 = LargerThan(FirstNumber=multiplication_23, SecondNumber=0)  # -> LargerThan, OrEqualTo
not_7 = GateNot(A=larger_6.LargerThan)
dispatch_20 = Dispatch(List=srf4pt_26, DispatchPattern=not_7)  # -> ListA, ListB
dispatch_21 = Dispatch(List=srf4pt_27, DispatchPattern=not_7)  # -> ListA, ListB
dispatch_22 = Dispatch(List=srf4pt_28, DispatchPattern=larger_6.LargerThan)  # -> ListA, ListB
srf_6 = Surface([dispatch_20.ListA, dispatch_21.ListA, dispatch_22.ListA])
filter_54 = StreamFilter(Gate=moment_mz_knm, Stream1=srf_6)
preview_29 = CustomPreview(Geometry=filter_54, Material=farbe_5)
tag_24 = TextTag(Location=flatten_63, Text=filter_53, Colour=farbe_3)
